# Grasshopper definition graphbypoints_tester.gh (Grasshopper 0.9.72)
# plug-ins: Ants

number_slider = Slider(7, range=0..100)
pt = Point(Point(-20.9, -9.6, 0))
box = CenterBox(Base=pt, X=number_slider, Y=number_slider, Z=number_slider)
number_slider_2 = Slider(5, range=0..10)
pop3d = Populate3D(Region=box, Count=Slider(55, range=0..100), Seed=Slider(0.2, range=0..1))
data = Data(pop3d)
sqgrid = Square(Plane=PlaneXY(0, 0, 0), Size=1, ExtentX=number_slider_2, ExtentY=number_slider_2)  # -> Cells, flatten(Points)
ptsgph = CreateGraphFromPoints(Points=data, Dist=Slider(6.612, range=0..50))
ptsgph_2 = CreateGraphFromPoints(Points=sqgrid.Points, Dist=Slider(1.7, range=0..10))
sg = SpatialGraph(ptsgph_2)
gphln = GraphToEdges(SpatialGraph=sg)
